# Grasshopper definition 1_oscillator.gh (Grasshopper 1.0.7)
# plug-ins: GHSynth

crv = Curve(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)
nickname = CVFromGeometryComponent(Curve=crv, SampleRate="200")
number_slider = Slider(0.1, range=0..0.1)
nickname_2 = CVQuantizer(Wave=nickname, scaleName="Major Pentatonic")
nickname_3 = CVOscillatorComponent(Frequency=nickname_2, Tuning=number_slider, wavetype="Square")
nickname_4 = CVOscillatorComponent(Frequency=nickname_2, wavetype="Sawtooth")
nickname_5 = CVOscillatorComponent(Frequency=nickname_2, Octave=Slider(-1, range=-1..2), Tuning=number_slider, wavetype="Square")
crv_2 = Curve(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)
nickname_6 = CVFromGeometryComponent(Curve=crv_2, SampleRate="200")
nickname_7 = MixerComponent(Wave=[nickname_4, nickname_3, nickname_5])
nickname_8 = VCAComponent(Wave=nickname_7, Amplitude=nickname_6)
nickname_9 = SampleToCurveComponent(Wave=nickname_8, Resolution="1000")
nickname_10 = AudioOutComponent(Wave=nickname_8)
