# Grasshopper definition 1_oscillator.gh (Grasshopper 1.0.7)
# plug-ins: Siren

crv = Curve([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])
nickname = CVFromGeometryComponent(Curve=crv, SampleRate="200")  # -> Wave, Trigger
number_slider = Slider(0.1, range=0..0.1)
nickname_2 = CVQuantizer(Wave=nickname.Wave, scaleName="Major Pentatonic")  # -> Wave, Trigger
nickname_3 = CVOscillatorComponent(Frequency=nickname_2.Wave, Tuning=number_slider, wavetype="Square")
nickname_4 = CVOscillatorComponent(Frequency=nickname_2.Wave, wavetype="Sawtooth")
nickname_5 = CVOscillatorComponent(Frequency=nickname_2.Wave, Octave=Slider(-1, range=-1..2), Tuning=number_slider, wavetype="Square")
nickname_6 = MixerComponent(Wave=[nickname_4, nickname_3, nickname_5])
crv_2 = Curve([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])
nickname_7 = CVFromGeometryComponent(Curve=crv_2, SampleRate="200")  # -> Wave, Trigger
nickname_8 = VCAComponent(Wave=nickname_6, Amplitude=nickname_7.Wave)
nickname_9 = AudioOutComponent(Wave=nickname_8)  # -> PlayProgress, Level
nickname_10 = SampleToCurveComponent(Wave=nickname_8, Resolution="1000", PlayProgress=nickname_9.PlayProgress)  # -> Polyline, Playhead
