# Grasshopper definition 2_drumMachine.gh (Grasshopper 1.0.7)
# plug-ins: GHSynth

number_slider = Slider(10, range=10..100)
number_slider_2 = Slider(120, range=0..1000)
number_slider_3 = Slider(3, range=0..10)
number_slider_4 = Slider(0, range=0..1)
xy = XYPlane(Origin=Point(0, 0, 0))
crv = Curve(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)
python = GhPythonScript(tempo=number_slider_2, division="3/16", T=number_slider, duration=number_slider_3, offset=number_slider_4)  # -> beats
# ---------- python: Python ----------
__author__ = "alasd"
__version__ = "2021.10.02"

from Rhino import Geometry as g

div_length = (tempo/60) * division * T

beats = [g.Point3d(offset*div_length, 0,0)]
if div_length > 0:
    elapsedTime = offset*div_length
    while elapsedTime < duration * T:
        elapsedTime += div_length
        point = g.Point3d(elapsedTime, 0,0)
        beats.append(point)
# ---------- end python ----------
python_2 = GhPythonScript(tempo=number_slider_2, division="1/2", T=number_slider, duration=number_slider_3, offset=Slider(0, range=0..1))  # -> beats; same code as python
python_3 = GhPythonScript(tempo=number_slider_2, division="1/4", T=number_slider, duration=number_slider_3, offset=number_slider_4)  # -> beats; same code as python
python_4 = GhPythonScript(tempo=number_slider_2, division="1/2", T=number_slider, duration=number_slider_3, offset=Slider(0.5, range=0..1))  # -> beats; same code as python
nickname = CVComponent(
    Curve=crv,
    Plane=xy,
    TimeFactor=number_slider,
    AmplitudeFactor=Slider(10, range=0..10),
    SampleRate=Slider(100, range=0..100))  # -> Wave, Trigger
merge = Merge(Data1=python_3, Data2=python)
nickname_2 = NoiseComponent(Duration=Slider(1, range=0..1), wavetype="White")
number_slider_5 = Slider(10000, range=0..10000)
number_slider_6 = Slider(10000, range=0..10000)
number_slider_7 = Slider(10000, range=0..10000)
path = FilePath("C:\Users\alasd\Downloads\musicradar-essential-drumkit-samples\DX_DMX Kit\DX Snare 01.wav")
path_2 = FilePath("C:\Users\alasd\Downloads\musicradar-essential-drumkit-samples\DX_DMX Kit\DX Kick 01.wav")
path_3 = FilePath("C:\Users\alasd\Downloads\musicradar-essential-drumkit-samples\DX_DMX Kit\DX Closed Hat 01.wav")
nickname_3 = ReadSampleComponent(Path=path)
nickname_4 = ReadSampleComponent(Path=path_2)
nickname_5 = ReadSampleComponent(Path=path_3)
nickname_6 = VCAComponent(Wave=nickname_2, Amplitude=nickname.Wave)
nickname_7 = SampleToCurveComponent(Wave=nickname_3, Resolution=number_slider_5)
nickname_8 = SampleToCurveComponent(Wave=nickname_4, Resolution=number_slider_6)
nickname_9 = SampleToCurveComponent(Wave=nickname_5, Resolution=number_slider_7)
number_slider_8 = Slider(10, range=0..10)
nickname_10 = CVComponent(Curve=nickname_7, SampleRate=number_slider_5)  # -> Wave, Trigger
nickname_11 = CVComponent(Curve=nickname_8, SampleRate=number_slider_6)  # -> Wave, Trigger
nickname_12 = CVComponent(Curve=nickname_9, AmplitudeFactor=Slider(40, range=0..100), SampleRate=number_slider_7)  # -> Wave, Trigger
crv_2 = Curve(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)
nickname_13 = CVComponent(Curve=crv_2, TimeFactor=number_slider_8, AmplitudeFactor=number_slider_8, SampleRate=Slider(20, range=0..100))  # -> Wave, Trigger
nickname_14 = SamplePlayerComponent(Sample=nickname_12.Wave, Points=merge, TimeFactor=number_slider)
nickname_15 = SamplePlayerComponent(Sample=nickname_10.Wave, Points=python_4, TimeFactor=number_slider)
nickname_16 = SamplePlayerComponent(Sample=nickname_11.Wave, Points=python_2, TimeFactor=number_slider)
nickname_17 = CVQuantizer(Wave=nickname_13.Wave, scaleName="Major Pentatonic")
nickname_18 = CVOscillatorComponent(Frequency=nickname_17, wavetype="Sawtooth")
nickname_19 = CVOscillatorComponent(Frequency=nickname_17, Tuning=Slider(5, range=0..10), wavetype="Sawtooth")
nickname_20 = SampleToCurveComponent(Wave=nickname_15, Resolution=Slider(275, range=0..1000))
python_5 = GhPythonScript(
    tempo=number_slider_2,
    division="1/3",
    T=Slider(10, range=10..100),
    duration=Slider(3, range=0..10),
    offset=Slider(0.5, range=0..1))  # -> beats; same code as python
nickname_21 = MixerComponent(Wave=[nickname_18, nickname_19])
nickname_22 = MixerComponent(Wave=[nickname_16, nickname_15, nickname_14])  # -> flatten(Wave)
python_6 = GhPythonScript(beats=python_5, amplitude=Slider(10, range=0..10))  # -> pl; inputs beats: list of Point3d
# ---------- python_6: Python ----------
__author__ = "alasd"
__version__ = "2021.10.02"

import rhinoscriptsyntax as rs
from Rhino import Geometry as g

pl = g.Polyline()
for i in range(len(beats)-1):
    ptA = beats[i] 
    ptB = beats[i] 
    ptC = beats[i+1] + g.Point3d(0,amplitude,0)
    pl.AddRange([ptA, ptB, ptC])

pl.ReduceSegments(0.01)
pl = pl.ToPolylineCurve()
# ---------- end python_6 ----------
nickname_23 = CVFromGeometryComponent(Curve=python_6, SampleRate=Slider(1000, range=0..1000))  # -> Wave, Trigger
nickname_24 = AttenuverterComponent(Wave=nickname_21, Attenuation=Slider(0.5, range=0..1))
nickname_25 = VCAComponent(Wave=nickname_21, Amplitude=nickname_23.Wave)  # -> flatten(Wave)
nickname_26 = MixerComponent(Wave=[nickname_22, nickname_25])
nickname_27 = AudioOutComponent(Wave=nickname_26)
