# Grasshopper definition 3_fmDrums.gh (Grasshopper 1.0.7)
# plug-ins: Siren

cvpt = PulseFromPoints(Point="0,0,0")
series = Series(Start=0, Step=2, Count=8)
cvpt_2 = PulseFromPoints(Point="0,0,0")
series_2 = Series(Start=0, Step=2, Count=8)
noise = Noise(Duration=Slider(2, range=0..10), wavetype="White")
reduce = RandomReduce(List=series, Reduction=Slider(4, range=0..10), Seed=1)
ad = ADEnvelopeGenerator(Trigger=cvpt, Decay=Slider(1.232, range=0..10), Exponent=Slider(6, range=0..10))
pt = ConstructPoint(XCoordinate=series_2, YCoordinate=0, ZCoordinate=0)
ad_2 = ADEnvelopeGenerator(Trigger=cvpt_2, Decay=Slider(0.151, range=0..10), Exponent=Slider(6, range=0..10))
pt_2 = ConstructPoint(XCoordinate=reduce, YCoordinate=0, ZCoordinate=0)
attenu = Attenuverter(Wave=noise, attenuation=0.4860448837)
attenu_2 = Attenuverter(Wave=ad, attenuation=0.3105525672)
attenu_3 = Attenuverter(Wave=ad_2, attenuation=0.9791560173)
cvpt_3 = PulseFromPoints(Point=pt)
cvpt_4 = PulseFromPoints(Point=pt_2)
fmosc = FMOscillatorComponent(Frequency=attenu_2, OPDepth=ad)
cvoff = CVPitchOffset(Wave=attenu, Octaves=Slider(3, range=0..10))
fmosc_2 = FMOscillatorComponent(Frequency=attenu_3, OPDepth=ad_2)
ad_3 = ADEnvelopeGenerator(Trigger=cvpt_3, Decay=Slider(0.927, range=0..10), Exponent=Slider(6, range=0..10))
vca = VCA(Wave=fmosc, Amplitude=ad)
vca_2 = VCA(Wave=fmosc_2, Amplitude=ad_2)
sample_hold = SampleHold(Wave=cvoff, Trigger=cvpt_3)
attenu_4 = Attenuverter(Wave=ad_3, attenuation=0.5328588486)
quant = CVQuantizer(Wave=sample_hold, scaleName="Major Pentatonic")  # -> Wave, Trigger
samplep = SamplePlayer(Sample=vca_2, Pulse=cvpt_3)
samplep_2 = SamplePlayer(Sample=vca, Pulse=cvpt_4)
fmosc_3 = FMOscillatorComponent(Frequency=quant.Wave, OPDepth=attenu_4)
mixer = Mixer(Wave=flatten([samplep_2, samplep, fmosc_3]))
trim = TrimSample(Wave=mixer, End=Slider(1.59, range=0..2))
repeat = RepeatData(Data=trim, Length=Slider(4, range=0..10))
nickname = SampleToPolyline(Wave=trim, Resolution=Slider(500, range=0..1000))  # -> Polyline, Playhead
stch = Stitch(Wave=repeat)
aout = AudioOut(WaveLeft=stch)  # -> PlayProgress, Level
